# Dynamo graph material & function.dyn (Dynamo 2.12.0.5650)
# packages: Clockwork for Dynamo 2.x 2.6.0, archi-lab.net 2023.213.1722

code_block = CodeBlock { "Walls"; }
byName = Category.ByName(name=code_block)
all_elements_of_category = ElementsOfCategory(Category=byName)
code_block_2 = CodeBlock { "cs_layers"; }
type = archilab.Revit.Elements.Elements.Type(element=all_elements_of_category)
python_script = Python(IN[0]=type)  # IronPython2
# ---------- python_script.python (32 lines) ----------
import clr
clr.AddReference('RevitAPI')
from Autodesk.Revit.DB import *

clr.AddReference("RevitNodes")
import Revit
clr.ImportExtensions(Revit.Elements)

items = UnwrapElement(IN[0])

def GetCompoundStructureLayers(item):
	layers = []
	layermat = []
	layerfunc = []

	try:
		if hasattr(item, "GetCompoundStructure"):
			compstruc = item.GetCompoundStructure()
			vertcomp = compstruc.IsVerticallyCompound
			varlayer = compstruc.VariableLayerIndex
			num = compstruc.LayerCount
			counter = 0
			while counter < num:
				layers.append(compstruc.GetLayers()[counter])
				layermat.append(item.Document.GetElement(compstruc.GetMaterialId(counter)))
				layerfunc.append(compstruc.GetLayerFunction(counter))
				counter += 1
	except: pass
	return layers, layermat, layerfunc

if isinstance(IN[0], list): OUT = map(list, zip(*[GetCompoundStructureLayers(x) for x in items]))
else: OUT = GetCompoundStructureLayers(items)
# ----------------------------------------
code_block_3 = CodeBlock(seq=python_script)
# ---------- code_block_3.designscript (6 lines) ----------
// Layers
seq[0];
// Materials
seq[1];
// Functions
seq[2];
# ----------------------------------------
count = List.Count(list=code_block_3.out0@L2)
string_from_object = FromObject(obj=count)
toNumber = String.ToNumber(string=string_from_object)
setParameterByName = Element.SetParameterByName(element=all_elements_of_category, parameterName=code_block_2, value=toNumber)
code_block_4 = CodeBlock { ""; }
parameter_types = ParameterTypeUi("Integer")
parameter_groups = ParameterGroupUi("PG_DATA")
boolean = BoolSelector(true)
code_block_5 = CodeBlock { "Walls"; }
byName_2 = Category.ByName(name=code_block_5)
createProjectParameter = Parameter.CreateProjectParameter(parameterName=code_block_2, groupName=code_block_4, type=parameter_types, group=parameter_groups, instance=boolean, categoryList=byName_2)  # frozen
passthrough = Custom[Passthrough](passThrough=setParameterByName, waitFor=createProjectParameter)  # package Clockwork for Dynamo 2.x
code_block_6 = CodeBlock { "material_class"; }
code_block_7 = CodeBlock { "; "; }
getMaterialClass = archilab.Revit.Elements.Materials.GetMaterialClass(material=code_block_3.out1)
join = String.Join(separator=code_block_7, string0=getMaterialClass@@L2)
flatten = List.Flatten(list=join)
setParameterByName_2 = Element.SetParameterByName(element=all_elements_of_category, parameterName=code_block_6, value=flatten)
code_block_8 = CodeBlock { ""; }
parameter_types_2 = ParameterTypeUi("Text")
parameter_groups_2 = ParameterGroupUi("PG_DATA")
boolean_2 = BoolSelector(true)
code_block_9 = CodeBlock { "Walls"; }
byName_3 = Category.ByName(name=code_block_9)
createProjectParameter_2 = Parameter.CreateProjectParameter(parameterName=code_block_6, groupName=code_block_8, type=parameter_types_2, group=parameter_groups_2, instance=boolean_2, categoryList=byName_3)  # frozen
passthrough_2 = Custom[Passthrough](passThrough=setParameterByName_2, waitFor=createProjectParameter_2)
code_block_10 = CodeBlock { "cs_function"; }
code_block_11 = CodeBlock { "; "; }
string_from_object_2 = FromObject(obj=code_block_3.out2)
join_2 = String.Join(separator=code_block_11, string0=string_from_object_2@@L2)
flatten_2 = List.Flatten(list=join_2)
setParameterByName_3 = Element.SetParameterByName(element=all_elements_of_category, parameterName=code_block_10, value=flatten_2)
code_block_12 = CodeBlock { ""; }
parameter_types_3 = ParameterTypeUi("Text")
parameter_groups_3 = ParameterGroupUi("PG_DATA")
boolean_3 = BoolSelector(true)
code_block_13 = CodeBlock { "Walls"; }
byName_4 = Category.ByName(name=code_block_13)
createProjectParameter_3 = Parameter.CreateProjectParameter(parameterName=code_block_10, groupName=code_block_12, type=parameter_types_3, group=parameter_groups_3, instance=boolean_3, categoryList=byName_4)  # frozen
passthrough_3 = Custom[Passthrough](passThrough=setParameterByName_3, waitFor=createProjectParameter_3)
