# Dynamo graph walls_dictionary_tojson.dyn (Dynamo 2.12.0.5650)
# packages: archi-lab.net 2023.213.1722

# group: Collect Walls
code_block = CodeBlock { "Walls"; }
byName = Category.ByName(name=code_block)
all_elements_of_category = ElementsOfCategory(Category=byName)

string_from_object = FromObject(obj=all_elements_of_category)
code_block_2 = CodeBlock { "Wall"; }
boolean = BoolSelector(true)
contains = String.Contains(string=string_from_object, searchFor=code_block_2, ignoreCase=boolean)
filterByBoolMask = List.FilterByBoolMask(list=all_elements_of_category, mask=contains)
code_block_3 = CodeBlock { "Exterior"; }
id = Element.Id(element=filterByBoolMask.in)
string_from_object_2 = FromObject(object=id)

# group: Collect Walls as Generic Models
code_block_4 = CodeBlock { "Generic Models"; }
byName_2 = Category.ByName(name=code_block_4)
all_elements_of_category_2 = ElementsOfCategory(Category=byName_2)
type = archilab.Revit.Elements.Elements.Type(element=all_elements_of_category_2)
code_block_5 = CodeBlock { "IfcExportAs"; }
getParameterValueByName = Element.GetParameterValueByName(element=type, parameterName=code_block_5)
code_block_6 = CodeBlock { "IfcCurtainWall"; }
eq = getParameterValueByName == code_block_6
filterByBoolMask_2 = List.FilterByBoolMask(list=all_elements_of_category_2, mask=eq)

id_2 = Element.Id(element=filterByBoolMask_2.in)
string_from_object_3 = FromObject(object=id_2)

# group: Room Wall Finish
code_block_7 = CodeBlock { "Rooms"; }
byName_3 = Category.ByName(name=code_block_7)
all_elements_of_category_3 = ElementsOfCategory(Category=byName_3)
python_script = Python(IN[0]=all_elements_of_category_3)  # IronPython2
# ---------- python_script.python (44 lines) ----------
import clr
clr.AddReference('RevitAPI')
from Autodesk.Revit.DB import *
import Autodesk

clr.AddReference("RevitNodes")
import Revit
clr.ImportExtensions(Revit.GeometryConversion)

def is_exterior_wall(wall):
    """ Check if the wall is an exterior wall """
    wall_type = wall.WallType
    function_param = wall_type.get_Parameter(BuiltInParameter.FUNCTION_PARAM)
    if function_param:
        return function_param.AsInteger() == int(WallFunction.Exterior)
    return False

items = UnwrapElement(IN[0])
faceelements = []

for item in items:
    doc = item.Document
    calculator = SpatialElementGeometryCalculator(doc)
    options = Autodesk.Revit.DB.SpatialElementBoundaryOptions()
    # get boundary location from area computation settings
    boundloc = Autodesk.Revit.DB.AreaVolumeSettings.GetAreaVolumeSettings(doc).GetSpatialElementBoundaryLocation(SpatialElementType.Room)
    options.SpatialElementBoundaryLocation = boundloc
    elist = []
    try:
        results = calculator.CalculateSpatialElementGeometry(item)
        for face in results.GetGeometry().Faces:
            for bface in results.GetBoundaryFaceInfo(face):
                # Check if the boundary face element is a wall
                eId = bface.SpatialBoundaryElement.HostElementId
                if eId != ElementId.InvalidElementId:  # Ensure there's an associated element
                    element = doc.GetElement(eId)
                    if isinstance(element, Wall) and is_exterior_wall(element):  # Check if the element is an exterior Wall
                        elist.append(element)
    except Exception as e:
        # You might want to handle or log the exception in a real scenario
        pass
    faceelements.append(elist)

OUT = faceelements
# ----------------------------------------
flatten = List.Flatten(list=python_script)
uniqueItems = List.UniqueItems(list=flatten)

# group: Get Elements properties
type_2 = archilab.Revit.Elements.Elements.Type(element=filterByBoolMask.in)
function = WallType.Function(wallType=type_2)
uniqueId = Element.UniqueId(element=filterByBoolMask.in)
code_block_8 = CodeBlock { "H_OQ_Kostengruppe"; }
getParameterValueByName_2 = Element.GetParameterValueByName(element=filterByBoolMask.in, parameterName=code_block_8)
name = Element.Name(element=filterByBoolMask.in)
familyName = ElementType.FamilyName(elementType=type_2)
room_bound = Python(IN[0]=filterByBoolMask.in, IN[1]=uniqueItems)  # IronPython2
# ---------- room_bound.python (15 lines) ----------
walls1 = IN[0]
walls2 = IN[1]

result = []
 
for wall in walls1:
	if wall in walls2:
		result.append(True)
	else:
		result.append(False)
		
		
OUT = result
		
	
# ----------------------------------------
list_create = List.Create(item0=getParameterValueByName_2, item1=name, item2=familyName, item3=function, item4=id, item5=room_bound)
code_block_9 = CodeBlock { "Structural Usage"; "cs_function"; "material_class"; }
list_create_2 = List.Create(item0=code_block_9.out0, item1=code_block_9.out1, item2=code_block_9.out2)
getParameterValueByName_3 = Element.GetParameterValueByName(element=filterByBoolMask.in@L1, parameterName=list_create_2)
transpose = List.Transpose(lists=getParameterValueByName_3)

replaceNull = archilab.Lists.Lists.ReplaceNull(list=function, replacement=code_block_3)

# group: Create Dictionary
code_block_10 = CodeBlock { "Kostengruppe"; "Name"; "Type"; "Function"; "Id"; "room_bound"; "LoadBearing"; "cs_function"; "material_class"; }
list_create_3 = List.Create(item0=code_block_10.out0, item1=code_block_10.out1, item2=code_block_10.out2, item3=code_block_10.out3, item4=code_block_10.out4, item5=code_block_10.out5, item6=code_block_10.out6, item7=code_block_10.out7, item8=code_block_10.out8)
join = List.Join(list0=list_create, list1=transpose)
transpose_2 = List.Transpose(lists=join)
byKeysValues = DesignScript.Builtin.Dictionary.ByKeysValues(keys=list_create_3, values=transpose_2@L2)

getCategory = archilab.Revit.Elements.Elements.GetCategory(element=filterByBoolMask_2.in)
string_from_object_4 = FromObject(obj=getCategory)
code_block_11 = CodeBlock { "H_OQ_Funktion Außen"; }

# group: Room Wall Finish
code_block_12 = CodeBlock { "Rooms"; }
byName_4 = Category.ByName(name=code_block_12)
all_elements_of_category_4 = ElementsOfCategory(Category=byName_4)
python_script_2 = Python(IN[0]=all_elements_of_category_4)  # IronPython2
# ---------- python_script_2.python (40 lines) ----------
import clr
clr.AddReference('RevitAPI')
from Autodesk.Revit.DB import *
import Autodesk

clr.AddReference("RevitNodes")
import Revit
clr.ImportExtensions(Revit.GeometryConversion)

items = UnwrapElement(IN[0])
faceelements = []

for item in items:
    doc = item.Document
    calculator = SpatialElementGeometryCalculator(doc)
    options = Autodesk.Revit.DB.SpatialElementBoundaryOptions()
    # get boundary location from area computation settings
    boundloc = Autodesk.Revit.DB.AreaVolumeSettings.GetAreaVolumeSettings(doc).GetSpatialElementBoundaryLocation(SpatialElementType.Room)
    options.SpatialElementBoundaryLocation = boundloc
    elist = []
    try:
        results = calculator.CalculateSpatialElementGeometry(item)
        for face in results.GetGeometry().Faces:
            for bface in results.GetBoundaryFaceInfo(face):
                # Check if the boundary face element is a wall
                eId = bface.SpatialBoundaryElement.HostElementId
                if eId != ElementId.InvalidElementId:  # Ensure there's an associated element
                    element = doc.GetElement(eId)
                    if isinstance(element, Wall):  # Check if the element is a Wall
                        elist.append(element)
                    else:
                        # If you need to handle linked walls, you can add similar logic here
                        # by checking the LinkedElementId and the type of the linked element.
                        pass
    except Exception as e:
        # You might want to handle or log the exception in a real scenario
        pass
    faceelements.append(elist)

OUT = faceelements
# ----------------------------------------
flatten_2 = List.Flatten(list=python_script_2)
uniqueItems_2 = List.UniqueItems(list=flatten_2)

# group: Get Elements properties
uniqueId_2 = Element.UniqueId(element=filterByBoolMask_2.in)
code_block_13 = CodeBlock { "H_OQ_Kostengruppe"; }
getParameterValueByName_4 = Element.GetParameterValueByName(element=filterByBoolMask_2.in, parameterName=code_block_13)
type_3 = archilab.Revit.Elements.Elements.Type(element=filterByBoolMask_2.in)
familyName_2 = ElementType.FamilyName(elementType=type_3)
room_bound_2 = Python(IN[0]=filterByBoolMask_2.in, IN[1]=uniqueItems_2)  # IronPython2; same code as room_bound
code_block_14 = CodeBlock { "Structural Usage"; "cs_function"; "material_class"; }
list_create_4 = List.Create(item0=code_block_14.out0, item1=code_block_14.out1, item2=code_block_14.out2)
getParameterValueByName_5 = Element.GetParameterValueByName(element=filterByBoolMask_2.in@L1, parameterName=list_create_4)

join_2 = List.Join(list0=uniqueId, list1=uniqueId_2)
getParameterValueByName_6 = Element.GetParameterValueByName(element=type_3, parameterName=code_block_11)

# group (continued): Get Elements properties
list_create_5 = List.Create(item0=getParameterValueByName_4, item1=familyName_2, item2=string_from_object_4, item3=getParameterValueByName_6, item4=id_2, item5=room_bound_2)

transpose_3 = List.Transpose(lists=getParameterValueByName_5)

# group: Create Dictionary
code_block_15 = CodeBlock { "Kostengruppe"; "Name"; "Type"; "Function"; "Id"; "room_bound"; "LoadBearing"; "cs_function"; "material_class"; }
list_create_6 = List.Create(item0=code_block_15.out0, item1=code_block_15.out1, item2=code_block_15.out2, item3=code_block_15.out3, item4=code_block_15.out4, item5=code_block_15.out5, item6=code_block_15.out6, item7=code_block_15.out7, item8=code_block_15.out8)
join_3 = List.Join(list0=list_create_5, list1=transpose_3)
transpose_4 = List.Transpose(lists=join_3)
byKeysValues_2 = DesignScript.Builtin.Dictionary.ByKeysValues(keys=list_create_6, values=transpose_4@L2)

join_4 = List.Join(list0=byKeysValues, list1=byKeysValues_2)
byKeysValues_3 = DesignScript.Builtin.Dictionary.ByKeysValues(keys=join_2, values=join_4)
stringifyJSON = Data.StringifyJSON(values=byKeysValues_3)
directory_path = Directory("C:\Users\yasmin.ragab\Downloads\Thesis\Test_Data\Json_files")  # graph input
file_name = StringInput("Test_Building_01")  # graph input
export_json_file = Python(IN[0]=stringifyJSON, IN[1]=directory_path, IN[2]=file_name)  # IronPython2
# ---------- export_json_file.python (33 lines) ----------
import clr
import json
import os
import codecs

# Inputs
json_data = IN[0]      # The JSON data to write to the file
directory_path = IN[1] # The directory path where you want to save the JSON file
file_name = IN[2]      # The file name for the JSON file

# Ensure the file name ends with .json
if not file_name.endswith('.json'):
    file_name += '.json'

# Ensure the directory exists
if not os.path.exists(directory_path):
    os.makedirs(directory_path)

# Combine the directory path and file name to create the full file path
file_path = os.path.join(directory_path, file_name)

# Ensure json_data is properly encoded as a JSON string
if not isinstance(json_data, str):
    json_data = json.dumps(json_data, ensure_ascii=False, indent=4)

# Write the JSON data to the file using codecs to handle encoding
try:
    with codecs.open(file_path, 'w', 'utf-8') as json_file:
        json_file.write(json_data)
    OUT = "File saved in {}".format(file_path)
except UnicodeEncodeError as e:
    OUT = "Encoding Error: {}".format(e)
    raise
# ----------------------------------------
output = Watch(export_json_file)  # graph output
